# Grasshopper definition 180631_visualization.gh (Grasshopper 1.0.5)
# plug-ins: MeshEdit Components, Octopus

# ----
# Model Unit = Meter !!!
button = Button()
ladybug = Ladybug_Ladybug()  # -> Vviiiiiiiiiizzz; plug-in component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
python = PythonScript(reset=button)  # -> read_me
# ---------- python: Python ----------
import scriptcontext as sc

if `sc.doc.ModelUnitSystem`!= 'Rhino.UnitSystem.Meters':
    print 'Change the units to METERS!'
else:
    print 'Good to go!'
# ---------- end python ----------
panel = Panel(python)

# ----
# 보행로 경우의 수 BC
양면주차보행로수 = Slider(1, range=1..2)

# ----
# 주차장설계규격
각도단위 = Slider(4, range=0..10)
횡단보도폭 = Slider(2, range=0..10)

# ----
# 횡단보도 경우의 수
각도변형 = Slider(0, range=-4..4)
횡단보도가로이동 = Slider(14, range=9..20)

# ----
# 보행로 경우의 수 D
보행로위치 = Slider(1, range=1..2)

# ----
# 주차장설계규격
도로폭 = Slider(6, range=0..10)
주차세로폭 = Slider(5, range=0..10)
가로추차칸수 = Slider(30, range=10..30)
보행로폭 = Slider(1, range=0..10)

# ----
# 기본위치_주차_A
주차가로폭 = Panel("2.5")
multiplication = Multiplication(A=가로추차칸수, B=주차가로폭)
construct_point = ConstructPoint(XCoordinate=0, YCoordinate=0, ZCoordinate=0)
주차 = Rectangle(Plane=construct_point, XSize=multiplication, YSize=주차세로폭, Radius=0)  # -> Rectangle, Length

# ----
# 기본위치_주차_BC
양면주차칸 = Panel("2")
multiplication_2 = Multiplication(A=보행로폭, B=양면주차보행로수)
multiplication_3 = Multiplication(A=주차세로폭, B=양면주차칸)
addition = Addition(A=multiplication_2, B=multiplication_3)
addition_2 = Addition(A=주차세로폭, B=도로폭)
construct_point_2 = ConstructPoint(XCoordinate=0, YCoordinate=addition_2, ZCoordinate=0)
양면주차_보행 = Rectangle(Plane=construct_point_2, XSize=multiplication, YSize=addition, Radius=0)  # -> Rectangle, Length

# ----
# 기본위치_도로_북측
addition_3 = Addition(A=addition_2, B=addition)
construct_point_3 = ConstructPoint(XCoordinate=0, YCoordinate=addition_3, ZCoordinate=0)
도로 = Rectangle(Plane=construct_point_3, XSize=multiplication, YSize=도로폭, Radius=0)  # -> Rectangle, Length

# ----
# 기본위치_주차_D
addition_4 = Addition(A=addition_3, B=도로폭)
addition_5 = Addition(A=보행로폭, B=주차세로폭)
construct_point_4 = ConstructPoint(XCoordinate=0, YCoordinate=addition_4, ZCoordinate=0)
rectangle = Rectangle(Plane=construct_point_4, XSize=multiplication, YSize=addition_5, Radius=0)  # -> Rectangle, Length; "주차+보행"

# ----
# 기본위치_횡단보도
series = Series(Start=0, Step=주차가로폭, Count=가로추차칸수)
addition_6 = Addition(A=addition_4, B=addition_5)
construct_point_5 = ConstructPoint(XCoordinate=0, YCoordinate=expr("x*3", addition_6), ZCoordinate=0)
construct_point_6 = ConstructPoint(XCoordinate=0, YCoordinate=0, ZCoordinate=0)
construct_point_7 = ConstructPoint(XCoordinate=series, YCoordinate=0, ZCoordinate=0)
list_item = ListItem(List=series, Index=횡단보도가로이동, Wrap=False)
unit_x = UnitX(Factor=list_item)
line = Line(StartPoint=construct_point_6, EndPoint=construct_point_5)
multiplication_4 = Multiplication(A=각도변형, B=각도단위)
move = Move(Geometry=construct_point_6, Motion=unit_x)  # -> Geometry, Transform
move_2 = Move(Geometry=line, Motion=unit_x)  # -> Geometry, Transform
rotate = Rotate(Geometry=move_2.Geometry, Angle=degrees(multiplication_4), Plane=move.Geometry)  # -> Geometry, Transform
unit_y = UnitY(Factor=expr("-x", addition_6))
왼쪽횡단 = Move(Geometry=rotate.Geometry, Motion=unit_y)  # -> Geometry, Transform
오른쪽횡단 = OffsetCurve(Curve=왼쪽횡단.Geometry, Distance=횡단보도폭, Plane=PlaneXY(0, 0, 0), Corners=1)
횡단보도면 = Loft(
    Curves=flatten([왼쪽횡단.Geometry, 오른쪽횡단]),
    Options={Adjust=False, Closed=False, LoftEnds=0, LoftSimp=0, LoftType=0, Rebuild=10, Refit=0.01})

# ----
# 기본위치_도로_남측
construct_point_8 = ConstructPoint(XCoordinate=0, YCoordinate=주차세로폭, ZCoordinate=0)
도로_2 = Rectangle(Plane=construct_point_8, XSize=multiplication, YSize=도로폭, Radius=0)  # -> Rectangle, Length

# ----
# 보행로 경우의 수 BC
양면주차보행로수_2 = Number(양면주차보행로수)
ghpython_script = GhPythonScript(x=양면주차보행로수_2)  # -> out, a
# ---------- ghpython_script: Python ----------
__author__ = "kimseongjun"
__version__ = "2018.06.29"

import rhinoscriptsyntax as rs

if x==1:
    a = {0,5,6}
else:
    a = {0,1,6,11}
# ---------- end ghpython_script ----------
addition_7 = Addition(A=ghpython_script.a, B=addition_2)
construct_point_9 = ConstructPoint(XCoordinate=0, YCoordinate=addition_7, ZCoordinate=0)
ghpython_script_2 = GhPythonScript(x=양면주차보행로수_2)  # -> out, a
# ---------- ghpython_script_2: Python ----------
__author__ = "kimseongjun"
__version__ = "2018.06.29"

import rhinoscriptsyntax as rs

if x==1:
    a = 1
else:
    a = 0
# ---------- end ghpython_script_2 ----------
ghpython_script_3 = GhPythonScript(x=양면주차보행로수_2)  # -> out, a
# ---------- ghpython_script_3: Python ----------
__author__ = "kimseongjun"
__version__ = "2018.06.29"

import rhinoscriptsyntax as rs

if x==1:
    a = 0
else:
    a = 1
# ---------- end ghpython_script_3 ----------
list_item_2 = ListItem(List=construct_point_9, Index="2", Wrap=False)
list_item_3 = ListItem(List=construct_point_9, Index=ghpython_script_2.a, Wrap=False)
list_item_4 = ListItem(List=construct_point_9, Index="3", Wrap=False)
list_item_5 = ListItem(List=construct_point_9, Index=ghpython_script_3.a, Wrap=False)
주차_2 = Rectangle(Plane=list_item_2, XSize=multiplication, YSize=주차세로폭, Radius=0)  # -> Rectangle, Length
보행로 = Rectangle(Plane=list_item_4, XSize=multiplication, YSize=보행로폭, Radius=0)  # -> Rectangle, Length
보행로_2 = Rectangle(Plane=list_item_3, XSize=multiplication, YSize=보행로폭, Radius=0)  # -> Rectangle, Length
주차_3 = Rectangle(Plane=list_item_5, XSize=multiplication, YSize=주차세로폭, Radius=0)  # -> Rectangle, Length

# ----
# 보행로 경우의 수 D
ghpython_script_4 = GhPythonScript(x=보행로위치)  # -> out, a
# ---------- ghpython_script_4: Python ----------
__author__ = "kimseongjun"
__version__ = "2018.06.29"

import rhinoscriptsyntax as rs

if x==1:
    a = {0,1}
else:
    a = {5,0}
# ---------- end ghpython_script_4 ----------
addition_8 = Addition(A=addition_4, B=ghpython_script_4.a)
construct_point_10 = ConstructPoint(XCoordinate=0, YCoordinate=addition_8, ZCoordinate=0)
list_item_6 = ListItem(List=construct_point_10, Index=보행로위치, Wrap=True)  # -> Item, Item1
주차_4 = Rectangle(Plane=list_item_6.Item, XSize=multiplication, YSize=주차세로폭, Radius=0)  # -> Rectangle, Length
보행로_3 = Rectangle(Plane=list_item_6.Item1, XSize=multiplication, YSize=보행로폭, Radius=0)  # -> Rectangle, Length

주차세로폭_2 = Number(주차세로폭)
주차가로폭_2 = Number(주차가로폭)

# ----
# 최종위치_주차_A
주차_5 = Curve(주차.Rectangle)
curve_curve = CurveCurve(CurveA=주차_5, CurveB=횡단보도면)  # -> Points, ParamsA, ParamsB
region_difference = RegionDifference(CurvesA=주차_5, CurvesB=횡단보도면)  # disabled
list_item_7 = ListItem(List=curve_curve.Points, Index=0, Wrap=True)  # -> Item, Item1, Item2, Item3
deconstruct = Deconstruct(Point=list_item_7.Item)  # -> XComponent, YComponent, ZComponent
deconstruct_2 = Deconstruct(Point=list_item_7.Item3)  # -> XComponent, YComponent, ZComponent
deconstruct_3 = Deconstruct(Point=list_item_7.Item2)  # -> XComponent, YComponent, ZComponent
deconstruct_4 = Deconstruct(Point=list_item_7.Item1)  # -> XComponent, YComponent, ZComponent
sort_list = SortList(
    Keys=flatten([deconstruct.XComponent, deconstruct_2.XComponent, deconstruct_4.XComponent, deconstruct_3.XComponent]),
    ValuesValuesA=flatten([deconstruct.XComponent, deconstruct_2.XComponent, deconstruct_4.XComponent, deconstruct_3.XComponent]))  # -> Keys, ValuesValuesA
list_item_8 = ListItem(List=sort_list.Keys, Index=0, Wrap=True)  # -> Item, Item1, Item2, Item3
division = Division(A=list_item_8.Item3, B=주차가로폭_2)
division_2 = Division(A=list_item_8.Item, B=주차가로폭_2)
ghpython_script_5 = GhPythonScript(x=division)  # -> out, a
# ---------- ghpython_script_5: Python ----------
__author__ = "kimseongjun"
__version__ = "2018.06.29"

import rhinoscriptsyntax as rs
import math

k = int(0)
k = round(x)

if x >= k:
    a = k+1
else:
    a = k
# ---------- end ghpython_script_5 ----------
ghpython_script_6 = GhPythonScript(x=division_2)  # -> out, a
# ---------- ghpython_script_6: Python ----------
__author__ = "kimseongjun"
__version__ = "2018.06.29"

import rhinoscriptsyntax as rs
import math

k = int(0)
k = round(x+0.002)

if x+0.002 >= k:
    a = k
else:
    a = k-1
# ---------- end ghpython_script_6 ----------
multiplication_5 = Multiplication(A=ghpython_script_5.a, B=주차가로폭_2)
subtraction = Subtraction(A=가로추차칸수, B=ghpython_script_5.a)
series_2 = Series(Start=0, Step=주차가로폭_2, Count=ghpython_script_6.a)
series_3 = Series(Start=multiplication_5, Step=주차가로폭_2, Count=subtraction)
construct_point_11 = ConstructPoint(XCoordinate=series_2, YCoordinate=0, ZCoordinate=0)
construct_point_12 = ConstructPoint(XCoordinate=series_3, YCoordinate=0, ZCoordinate=0)
주차_a1 = Rectangle(Plane=construct_point_11, XSize=주차가로폭_2, YSize=주차세로폭_2, Radius=0)  # -> Rectangle, Length
주차_a2 = Rectangle(Plane=construct_point_12, XSize=주차가로폭_2, YSize=주차세로폭_2, Radius=0)  # -> Rectangle, Length

# ----
# 최종위치_주차_B
주차_6 = Curve(주차_3.Rectangle)
curve_curve_2 = CurveCurve(CurveA=주차_6, CurveB=횡단보도면)  # -> Points, ParamsA, ParamsB
region_difference_2 = RegionDifference(CurvesA=주차_6, CurvesB=횡단보도면)  # disabled
list_item_9 = ListItem(List=curve_curve_2.Points, Index=0, Wrap=True)  # -> Item, Item1, Item2, Item3
deconstruct_5 = Deconstruct(Point=list_item_9.Item)  # -> XComponent, YComponent, ZComponent
deconstruct_6 = Deconstruct(Point=list_item_9.Item3)  # -> XComponent, YComponent, ZComponent
deconstruct_7 = Deconstruct(Point=list_item_9.Item2)  # -> XComponent, YComponent, ZComponent
deconstruct_8 = Deconstruct(Point=list_item_9.Item1)  # -> XComponent, YComponent, ZComponent
sort_list_2 = SortList(
    Keys=flatten([deconstruct_5.XComponent, deconstruct_6.XComponent, deconstruct_8.XComponent, deconstruct_7.XComponent]),
    ValuesValuesA=flatten([deconstruct_5.XComponent, deconstruct_6.XComponent, deconstruct_8.XComponent, deconstruct_7.XComponent]))  # -> Keys, ValuesValuesA
list_item_10 = ListItem(List=sort_list_2.Keys, Index=0, Wrap=True)  # -> Item, Item1, Item2, Item3
division_3 = Division(A=list_item_10.Item3, B=주차가로폭_2)
division_4 = Division(A=list_item_10.Item, B=주차가로폭_2)
ghpython_script_7 = GhPythonScript(x=division_3)  # -> out, a; same code as ghpython_script_5
ghpython_script_8 = GhPythonScript(x=division_4)  # -> out, a
# ---------- ghpython_script_8: Python ----------
__author__ = "kimseongjun"
__version__ = "2018.06.29"

import rhinoscriptsyntax as rs
import math

k = int(0)
k = round(x+0.02)

if x+0.02 >= k:
    a = k
else:
    a = k-1
# ---------- end ghpython_script_8 ----------
multiplication_6 = Multiplication(A=ghpython_script_7.a, B=주차가로폭_2)
subtraction_2 = Subtraction(A=가로추차칸수, B=ghpython_script_7.a)
series_4 = Series(Start=0, Step=주차가로폭_2, Count=ghpython_script_8.a)
series_5 = Series(Start=multiplication_6, Step=주차가로폭_2, Count=subtraction_2)
construct_point_13 = ConstructPoint(XCoordinate=series_4, YCoordinate=list_item_5, ZCoordinate=0)
construct_point_14 = ConstructPoint(XCoordinate=series_5, YCoordinate=list_item_5, ZCoordinate=0)
주차_b1 = Rectangle(Plane=construct_point_13, XSize=주차가로폭_2, YSize=주차세로폭_2, Radius=0)  # -> Rectangle, Length
주차_b2 = Rectangle(Plane=construct_point_14, XSize=주차가로폭_2, YSize=주차세로폭_2, Radius=0)  # -> Rectangle, Length

# ----
# 최종위치_주차_C
주차_7 = Curve(주차_2.Rectangle)
curve_curve_3 = CurveCurve(CurveA=주차_7, CurveB=횡단보도면)  # -> Points, ParamsA, ParamsB
region_difference_3 = RegionDifference(CurvesA=주차_7, CurvesB=횡단보도면)  # disabled
list_item_11 = ListItem(List=curve_curve_3.Points, Index=0, Wrap=True)  # -> Item, Item1, Item2, Item3
deconstruct_9 = Deconstruct(Point=list_item_11.Item)  # -> XComponent, YComponent, ZComponent
deconstruct_10 = Deconstruct(Point=list_item_11.Item3)  # -> XComponent, YComponent, ZComponent
deconstruct_11 = Deconstruct(Point=list_item_11.Item2)  # -> XComponent, YComponent, ZComponent
deconstruct_12 = Deconstruct(Point=list_item_11.Item1)  # -> XComponent, YComponent, ZComponent
sort_list_3 = SortList(
    Keys=flatten([deconstruct_9.XComponent, deconstruct_10.XComponent, deconstruct_12.XComponent, deconstruct_11.XComponent]),
    ValuesValuesA=flatten([deconstruct_9.XComponent, deconstruct_10.XComponent, deconstruct_12.XComponent, deconstruct_11.XComponent]))  # -> Keys, ValuesValuesA
list_item_12 = ListItem(List=sort_list_3.Keys, Index=0, Wrap=True)  # -> Item, Item1, Item2, Item3
division_5 = Division(A=list_item_12.Item3, B=주차가로폭_2)
division_6 = Division(A=list_item_12.Item, B=주차가로폭_2)
ghpython_script_9 = GhPythonScript(x=division_5)  # -> out, a; same code as ghpython_script_5
ghpython_script_10 = GhPythonScript(x=division_6)  # -> out, a; same code as ghpython_script_8
multiplication_7 = Multiplication(A=ghpython_script_9.a, B=주차가로폭_2)
subtraction_3 = Subtraction(A=가로추차칸수, B=ghpython_script_9.a)
series_6 = Series(Start=0, Step=주차가로폭_2, Count=ghpython_script_10.a)
series_7 = Series(Start=multiplication_7, Step=주차가로폭_2, Count=subtraction_3)
construct_point_15 = ConstructPoint(XCoordinate=series_6, YCoordinate=list_item_2, ZCoordinate=0)
construct_point_16 = ConstructPoint(XCoordinate=series_7, YCoordinate=list_item_2, ZCoordinate=0)
주차_c1 = Rectangle(Plane=construct_point_15, XSize=주차가로폭_2, YSize=주차세로폭_2, Radius=0)  # -> Rectangle, Length
주차_c2 = Rectangle(Plane=construct_point_16, XSize=주차가로폭_2, YSize=주차세로폭_2, Radius=0)  # -> Rectangle, Length

# ----
# 최종위치_도로_북측
도로_3 = Curve(도로.Rectangle)
도로_북측 = RegionDifference(CurvesA=도로_3, CurvesB=횡단보도면)

# ----
# 최종위치_도로_남측
도로_4 = Curve(도로_2.Rectangle)
도로_남측 = RegionDifference(CurvesA=도로_4, CurvesB=횡단보도면)

# ----
# 최종위치_보행로_c1c2
보행로_c1c2 = RegionDifference(CurvesA=보행로.Rectangle, CurvesB=횡단보도면)

# ----
# 최종위치_보행로_d1d2
보행로_d1d2 = RegionDifference(CurvesA=보행로_3.Rectangle, CurvesB=횡단보도면)

# ----
# 최종위치_보행로_b1b2
보행로_b1b2 = RegionDifference(CurvesA=보행로_2.Rectangle, CurvesB=횡단보도면)

a2 = Point(list_item_7.Item1)
a1 = Point(list_item_7.Item)

# ----
# 보행로길이_b1b2
deconstruct_brep = DeconstructBrep(Brep=보행로_b1b2)  # -> Faces, Edges, Vertices
b1 = ListItem(List=flatten(deconstruct_brep.Vertices), Index="1", Wrap=True)
deconstruct_13 = Deconstruct(Point=b1)  # -> XComponent, YComponent, ZComponent
b2 = ListItem(List=flatten(deconstruct_brep.Vertices), Index="5", Wrap=True)
deconstruct_14 = Deconstruct(Point=b2)  # -> XComponent, YComponent, ZComponent
b1_2 = Distance(PointA=a1, PointB=b1)
b2_2 = Distance(PointA=a2, PointB=b2)
b1_3 = Subtraction(A=deconstruct_13.XComponent, B=series_4)
b2_3 = Subtraction(A=series_5, B=deconstruct_14.XComponent)
b1_4 = Addition(A=b1_2, B=b1_3)
b2_4 = Addition(A=b2_2, B=b2_3)

# ----
# 보행로길이_c1c2
deconstruct_brep_2 = DeconstructBrep(Brep=보행로_c1c2)  # -> Faces, Edges, Vertices
ghpython_script_11 = GhPythonScript(x=양면주차보행로수)  # -> out, a
# ---------- ghpython_script_11: Python ----------
__author__ = "kimseongjun"
__version__ = "2018.06.30"

import rhinoscriptsyntax as rs
if x==1:
    a=1
else:
    a=0
# ---------- end ghpython_script_11 ----------
c1 = ListItem(List=flatten(deconstruct_brep_2.Vertices), Index="1", Wrap=True)
merge = Merge(Data1=c1, Data2=b1)
list_item_13 = ListItem(List=merge, Index=ghpython_script_11.a, Wrap=True)
c2 = ListItem(List=flatten(deconstruct_brep_2.Vertices), Index="5", Wrap=True)
merge_2 = Merge(Data1=c2, Data2=b2)
list_item_14 = ListItem(List=merge_2, Index=ghpython_script_11.a, Wrap=True)
deconstruct_15 = Deconstruct(Point=list_item_13)  # -> XComponent, YComponent, ZComponent
deconstruct_16 = Deconstruct(Point=list_item_14)  # -> XComponent, YComponent, ZComponent
c2_2 = Distance(PointA=a2, PointB=c2)
c1_2 = Distance(PointA=a1, PointB=c1)
c1_3 = Subtraction(A=deconstruct_15.XComponent, B=series_6)
c2_3 = Subtraction(A=series_7, B=deconstruct_16.XComponent)
merge_3 = Merge(Data1=c1_2, Data2=b1_2)
ghpython_script_12 = GhPythonScript(x=양면주차보행로수)  # -> out, a; same code as ghpython_script_11
list_item_15 = ListItem(List=merge_3, Index=ghpython_script_12.a, Wrap=True)
c1_4 = Addition(A=list_item_15, B=c1_3)
c2_4 = Addition(A=list_item_15, B=c2_3)

# ----
# Legend Parameters
list = ValueList({"Original Ladybug": 0, "Nuanced Ladybug": 1, "Multi-colored Ladybug": 2, "View Analysis 1": 3, "View Analysis 2 (Red,Green,Blue)": 4, "Sunlight Hours": 5, "Ecotect": 6, "Thermal Comfort Percentage": 7, "Thermal Comfort Colors": 8, "Thermal Comfort Colors (UTCI)": 9, "Hot Hours": 10, "Cold Hours": 11, "Shade Benefit/Harm": 12, "Thermal Comfort Colors v2 (UTCI)": 13, "Shade Harm": 14, "Shade Benefit": 15, "Black to White": 16, "CFD Colors 1": 17, "CFD Colors 2": 18, "Blue to Yellow": 19}, selected="Cold Hours")
gradientlibrary = Ladybug_GradientLibrary(gradIndex=list)  # -> customColors; plug-in component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
legendpar = Ladybug_LegendParameters(customColors=flatten(gradientlibrary))  # -> legendPar; plug-in component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

# ----
# Sunpath
boolean_toggle = BooleanToggle(False)

# ----
# Analysis Period
number_slider = Slider(18, range=1..24)
list_2 = ValueList({"1. January": 1, "2. February": 2, "3. March": 3, "4. April": 4, "5. May": 5, "6. June": 6, "7. July": 7, "8. August": 8, "9. September": 9, "10. October": 10, "11. November": 11, "12. December": 12}, selected="3. March")
list_3 = ValueList({"1. January": 1, "2. February": 2, "3. March": 3, "4. April": 4, "5. May": 5, "6. June": 6, "7. July": 7, "8. August": 8, "9. September": 9, "10. October": 10, "11. November": 11, "12. December": 12}, selected="3. March")
analysisperiod = Ladybug_AnalysisPeriod(
    fromMonth=list_3,
    fromDay=Slider(21, range=1..31),
    fromHour=Slider(8, range=1..24),
    toMonth=list_2,
    toDay=Slider(21, range=1..31),
    toHour=number_slider)  # -> readMe, analysisPeriod; plug-in component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

# ----
# epw file
path = FilePath("C:\Users\kimseongjun\Desktop\업무\DIG_POSCO_Generative\180322_parking\KOR_Inchon.471120_IWEC.epw")

# ----
# North
importlocation = Ladybug_ImportLocation(epwFile=path)  # -> location; plug-in component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
truenorth = Ladybug_TrueNorth(location=importlocation)  # -> out, trueNorth, trueNorthVec, magneticDeclination, magneticFieldVec; plug-in component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

# ----
# Import Weather Data
importepw = Ladybug_ImportEpw(epwFile=path)  # -> readMe, latitude, location, dryBulbTemperature, dewPointTemperature, relativeHumidity, windSpeed, windDirection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; plug-in component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

# ----
# Draw the sunpath
sunpath = Ladybug_SunPath(
    north=truenorth.trueNorth,
    location=importepw.location,
    hour=12,
    day=21,
    month=12,
    timeStep=1,
    analysisPeriod=analysisperiod.analysisPeriod,
    dailyOrAnnualSunPath=True,
    solarOrStandardTime=boolean_toggle)  # -> out, sunVectors, sunAltitudes, sunAzimuths, port, sunSpheresMesh, sunPathCrvs, compassCrvs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; plug-in component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

# ----
# Multi-objective Optimization
octopus = Octopus(OctopusData_gene=[양면주차보행로수, 보행로위치, 각도변형, 횡단보도가로이동], OctopusData_obj=[주차대수_3, 태양광발전시간, 보행로길이_평균])

# ----
# 최종위치_주차_D
주차_8 = Curve(주차_4.Rectangle)
curve_curve_4 = CurveCurve(CurveA=주차_8, CurveB=횡단보도면)  # -> Points, ParamsA, ParamsB
region_difference_4 = RegionDifference(CurvesA=주차_8, CurvesB=횡단보도면)  # disabled
list_item_16 = ListItem(List=curve_curve_4.Points, Index=0, Wrap=True)  # -> Item, Item1, Item2, Item3
deconstruct_17 = Deconstruct(Point=list_item_16.Item)  # -> XComponent, YComponent, ZComponent
deconstruct_18 = Deconstruct(Point=list_item_16.Item3)  # -> XComponent, YComponent, ZComponent
deconstruct_19 = Deconstruct(Point=list_item_16.Item2)  # -> XComponent, YComponent, ZComponent
deconstruct_20 = Deconstruct(Point=list_item_16.Item1)  # -> XComponent, YComponent, ZComponent
sort_list_4 = SortList(
    Keys=flatten([deconstruct_17.XComponent, deconstruct_18.XComponent, deconstruct_20.XComponent, deconstruct_19.XComponent]),
    ValuesValuesA=flatten([deconstruct_17.XComponent, deconstruct_18.XComponent, deconstruct_20.XComponent, deconstruct_19.XComponent]))  # -> Keys, ValuesValuesA
list_item_17 = ListItem(List=sort_list_4.Keys, Index=0, Wrap=True)  # -> Item, Item1, Item2, Item3
division_7 = Division(A=list_item_17.Item, B=주차가로폭_2)
division_8 = Division(A=list_item_17.Item3, B=주차가로폭_2)
ghpython_script_13 = GhPythonScript(x=division_7)  # -> out, a; same code as ghpython_script_8
ghpython_script_14 = GhPythonScript(x=division_8)  # -> out, a; same code as ghpython_script_5
subtraction_4 = Subtraction(A=가로추차칸수, B=ghpython_script_14.a)
multiplication_8 = Multiplication(A=ghpython_script_14.a, B=주차가로폭_2)
series_8 = Series(Start=multiplication_8, Step=주차가로폭_2, Count=subtraction_4)
construct_point_17 = ConstructPoint(XCoordinate=series_8, YCoordinate=list_item_6.Item, ZCoordinate=0)
주차_d2 = Rectangle(Plane=construct_point_17, XSize=주차가로폭_2, YSize=주차세로폭_2, Radius=0)  # -> Rectangle, Length

# ----
# d1d2빈틈
list_item_18 = ListItem(List=series_8, Index=0, Wrap=True)
multiplication_9 = Multiplication(A=ghpython_script_13.a, B=주차가로폭)
subtraction_5 = Subtraction(A=list_item_18, B=multiplication_9)
division_9 = Division(A=subtraction_5, B=주차가로폭)
ghpython_script_15 = GhPythonScript(x=보행로위치)  # -> out, a
# ---------- ghpython_script_15: Python ----------
__author__ = "kimseongjun"
__version__ = "2018.07.01"

import rhinoscriptsyntax as rs
if x==1:
    a=1
else:
    a=0
# ---------- end ghpython_script_15 ----------
multiplication_10 = Multiplication(A=ghpython_script_15.a, B=division_9)
addition_9 = Addition(A=ghpython_script_13.a, B=multiplication_10)  # -> flatten(Result)

series_9 = Series(Start=0, Step=주차가로폭_2, Count=addition_9)
construct_point_18 = ConstructPoint(XCoordinate=series_9, YCoordinate=list_item_6.Item, ZCoordinate=0)
주차_d1 = Rectangle(Plane=construct_point_18, XSize=주차가로폭_2, YSize=주차세로폭_2, Radius=0)  # -> Rectangle, Length

# ----
# 최종위치_횡단보도
횡단보도_오른쪽 = Line(StartPoint=list_item_7.Item1, EndPoint=list_item_16.Item2)
횡단보도_왼쪽 = Line(StartPoint=list_item_7.Item, EndPoint=list_item_16.Item3)
횡단보도면_2 = Loft(
    Curves=[횡단보도_왼쪽, 횡단보도_오른쪽],
    Options={Adjust=False, Closed=False, LoftEnds=0, LoftSimp=0, LoftType=0, Rebuild=10, Refit=0.01})

# ----
# 태양광패널형태
주차장가로 = Slider(2.5, range=0..10)
캐노피높이 = Slider(2.1, range=0..10)
주차장세로 = Slider(5.9, range=0..10)
construct_point_19 = ConstructPoint(XCoordinate=0, YCoordinate=주차장세로, ZCoordinate=0)
construct_point_20 = ConstructPoint(XCoordinate=0, YCoordinate=0, ZCoordinate=0)
line_2 = Line(StartPoint=construct_point_20, EndPoint=construct_point_19)
yz_plane = YZPlane(Origin=Point(0, 0, 0))
rotate_2 = Rotate(Geometry=line_2, Angle=degrees(Slider(36, range=0..100)), Plane=yz_plane)  # -> Geometry, Transform
unit_x_2 = UnitX(Factor=주차장가로)
extrude = Extrude(Base=rotate_2.Geometry, Direction=unit_x_2)
unit_z = UnitZ(Factor=캐노피높이)
move_3 = Move(Geometry=extrude, Motion=unit_z)  # -> Geometry, Transform
merge_4 = Merge(
    Data1=construct_point_11,
    Data2=construct_point_12,
    Data3=construct_point_13,
    Data4=construct_point_14,
    Data5=construct_point_15,
    Data6=construct_point_16,
    Data7=construct_point_18,
    Data8=construct_point_17)
vector_2pt = Vector2Pt(PointA=construct_point_20, PointB=merge_4, Unitize=False)  # -> Vector, Length
move_4 = Move(Geometry=move_3.Geometry, Motion=vector_2pt.Vector)  # -> Geometry, Transform
mesh_surface = MeshSurface(Surface=move_4.Geometry, UCount=Slider(1, range=0..10), VCount=Slider(5, range=0..10), Overhang=True, Equalize=False)

# ----
# 보행로길이_d1d2
deconstruct_brep_3 = DeconstructBrep(Brep=보행로_d1d2)  # -> Faces, Edges, Vertices
d1 = ListItem(List=flatten(deconstruct_brep_3.Vertices), Index="1", Wrap=True)
d2 = ListItem(List=flatten(deconstruct_brep_3.Vertices), Index="5", Wrap=True)
d2_2 = Distance(PointA=a2, PointB=d2)
deconstruct_21 = Deconstruct(Point=d1)  # -> XComponent, YComponent, ZComponent
d1_2 = Distance(PointA=a1, PointB=d1)
deconstruct_22 = Deconstruct(Point=d2)  # -> XComponent, YComponent, ZComponent
d2_3 = Subtraction(A=series_8, B=deconstruct_22.XComponent)
d1_3 = Subtraction(A=deconstruct_21.XComponent, B=series_9)
d1_4 = Addition(A=d1_3, B=d1_2)
d2_4 = Addition(A=d2_3, B=d2_2)

# ----
# Objective_주차대수
merge_5 = Merge(
    Data1=주차_a1.Rectangle,
    Data2=주차_a2.Rectangle,
    Data3=주차_b1.Rectangle,
    Data4=주차_b2.Rectangle,
    Data5=주차_c1.Rectangle,
    Data6=주차_c2.Rectangle,
    Data7=주차_d1.Rectangle,
    Data8=주차_d2.Rectangle)
list_length = ListLength(List=merge_5)
주차대수 = Number(list_length)
주차대수_2 = Panel(주차대수)

# ----
# Objective_보행로길이
mass_addition = MassAddition(Input=[d2_4, d1_4, b2_4, b1_4, c2_4, c1_4])  # -> Result, PartialResults
list_length_2 = ListLength(List=mass_addition.PartialResults)
division_10 = Division(A=mass_addition.Result, B=list_length_2)
보행로길이_평균 = Number(division_10)
보행로길이 = Number(mass_addition.Result)
보행로길이_평균_2 = Panel(보행로길이_평균)
보행로길이_2 = Panel(보행로길이)

# ----
# Buildings
geometry = Geometry([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])
태양광패널_메쉬 = Mesh(mesh_surface)
주변건물 = Brep(geometry)
태양광패널 = Brep()

# ----
# Analysis Sunlight Hours
number_slider_2 = Slider(1, range=0..10)
simulation_on_off = BooleanToggle(True)
sunlighthoursanalysis = Ladybug_SunlightHoursAnalysis(
    geometry=flatten(태양광패널_메쉬),
    context=flatten(주변건물),
    gridSize=number_slider_2,
    disFromBase=Slider(0.01, range=0..0.01),
    sunVectors=flatten(sunpath.sunVectors),
    timeStep=1,
    legendPar=flatten(legendpar),
    parallel=simulation_on_off,
    runIt=simulation_on_off)  # -> readMe, contextMesh, analysisMesh, testPts, testVec, port, sunlightHoursResult, sunlightHoursMesh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; plug-in component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

# ----
# 경제성분석 후 일반/태양광 패널 배치
패널단가_원 = Panel("1200000")
개당_발전량_kw = Panel("0.4")
회수기간_년 = Panel("10")
파는단가_원_kw = Panel("120")
_1년_일 = Panel("365")
number = Number(패널단가_원)
number_2 = Number(_1년_일)
number_3 = Number(개당_발전량_kw)
number_4 = Number(회수기간_년)
number_5 = Number(파는단가_원_kw)
ghpython_script_16 = GhPythonScript(x=number, y=number_3, z=number_4, u=number_2, v=number_5)  # -> out, a
# ---------- ghpython_script_16: Python ----------
__author__ = "kimseongjun"
__version__ = "2018.06.30"

import rhinoscriptsyntax as rs
a = float(x/(y*z*u*v))
# ---------- end ghpython_script_16 ----------
기준시간 = Panel(ghpython_script_16.a)
mesh_explode = MeshExplode(Mesh=mesh_surface, Interpolate=False)  # -> simplify(Faces)
larger_than = LargerThan(FirstNumber=sunlighthoursanalysis.sunlightHoursResult, SecondNumber=기준시간)  # -> LargerThan, OrEqualTo
smaller_than = SmallerThan(FirstNumber=sunlighthoursanalysis.sunlightHoursResult, SecondNumber=기준시간)  # -> SmallerThan, OrEqualTo
일반패널 = CullPattern(List=mesh_explode, CullPattern=smaller_than.OrEqualTo)
태양광패널_2 = CullPattern(List=mesh_explode, CullPattern=larger_than.OrEqualTo)
태양광패널발전시간 = Multiplication(A=sunlighthoursanalysis.sunlightHoursResult, B=larger_than.OrEqualTo)

# ----
# Objective_태양광발전량 및 경제성
mass_addition_2 = MassAddition(Input=flatten(태양광패널발전시간))  # -> Result, PartialResults
number_6 = Number(mass_addition_2.Result)
총_태양광발전_시간 = Panel(number_6)

deconstruct_brep_4 = DeconstructBrep(Brep=move_3.Geometry)  # -> Faces, Edges, Vertices
deconstruct_23 = Deconstruct(Point=deconstruct_brep_4.Vertices)  # -> XComponent, YComponent, ZComponent
construct_point_21 = ConstructPoint(XCoordinate=deconstruct_23.XComponent, YCoordinate=deconstruct_23.YComponent, ZCoordinate=0)
line_3 = Line(StartPoint=construct_point_21, EndPoint=deconstruct_brep_4.Vertices)  # -> graft(Line)
move_5 = Move(Geometry=line_3, Motion=vector_2pt.Vector)  # -> Geometry, Transform
pipe = Pipe(Curve=move_5.Geometry, Radius=Slider(0.06, range=0..0.1), Caps=0)  # disabled
custom_preview = CustomPreview(Geometry=move_5.Geometry, Material=ColourSwatch(SwatchColor=RGBA(138, 138, 138, 108)))

# ----
# Visualization
panel_2 = Panel("2")
d1_5 = ListItem(List=flatten(deconstruct_brep_3.Vertices), Index=panel_2, Wrap=True)
d2_5 = ListItem(List=flatten(deconstruct_brep_3.Vertices), Index="4", Wrap=True)
line_4 = Line(StartPoint=a1, EndPoint=d1_5)
line_5 = Line(StartPoint=a2, EndPoint=d2_5)
boundary_surfaces = BoundarySurfaces(Edges=[보행로_c1c2, 보행로_b1b2, 보행로_d1d2])
loft = Loft(
    Curves=[line_4, line_5],
    Options={Adjust=False, Closed=False, LoftEnds=0, LoftSimp=0, LoftType=0, Rebuild=10, Refit=0.01})
보행로_4 = CustomPreview(Geometry=[boundary_surfaces, loft], Material=ColourSwatch(SwatchColor=RGBA(152, 217, 0, 206)))

number_slider_3 = Slider(-25, range=-50..0)
colour_swatch = ColourSwatch(SwatchColor=RGB(0, 166, 255))
construct_point_22 = ConstructPoint(XCoordinate=expr("-x", Slider(-19, range=-50..0)), YCoordinate=number_slider_3, ZCoordinate=0)
construct_point_23 = ConstructPoint(XCoordinate=0, YCoordinate=number_slider_3, ZCoordinate=0)
construct_point_24 = ConstructPoint(XCoordinate=expr("-x", Slider(-45, range=-50..0)), YCoordinate=number_slider_3, ZCoordinate=0)
text_join = TextJoin(Text=flatten(["주차대수 : ", 주차대수_2]))
text_join_2 = TextJoin(Text=flatten(["/ 총 발전시간 : ", 총_태양광발전_시간]))
text_join_3 = TextJoin(Text=flatten(["/ 평균보행로길이 : ", 보행로길이_평균_2]))
text_tag_3d = TextTag3D(Location=construct_point_23, Text=text_join, Size=Slider(2, range=0..100), Colour=colour_swatch, Justification=7)
text_tag_3d_2 = TextTag3D(Location=construct_point_22, Text=text_join_2, Size=Slider(2, range=0..100), Colour=colour_swatch, Justification=7)
text_tag_3d_3 = TextTag3D(Location=construct_point_24, Text=text_join_3, Size=Slider(2, range=0..100), Colour=colour_swatch, Justification=7)

mesh_edges = MeshEdges(Mesh=sunlighthoursanalysis.sunlightHoursMesh)  # -> NakedEdges, InteriorEdges, NonManifoldEdges
패널그리드 = CustomPreview(Geometry=[mesh_edges.InteriorEdges, mesh_edges.NakedEdges], Material=ColourSwatch(SwatchColor=RGB(0, 221, 255)))

주차레이아웃 = CustomPreview(
    Geometry=[주차_a1.Rectangle, 주차_a2.Rectangle, 주차_b1.Rectangle, 주차_b2.Rectangle, 주차_c1.Rectangle, 주차_c2.Rectangle, 주차_d1.Rectangle, 주차_d2.Rectangle],
    Material=ColourSwatch(SwatchColor=RGB(255, 255, 255)))

일반패널_2 = CustomPreview(Geometry=일반패널, Material=ColourSwatch(SwatchColor=RGBA(255, 0, 0, 184)))

text_tag = TextTag(
    Location=sunlighthoursanalysis.testPts,
    Text=sunlighthoursanalysis.sunlightHoursResult,
    Colour=ColourSwatch(SwatchColor=RGBA(255, 255, 255, 0)))

multiplication_11 = Multiplication(A=number_6, B="-1")
태양광발전시간 = Number(multiplication_11)

multiplication_12 = Multiplication(A=주차대수, B="-1")
주차대수_3 = Number(multiplication_12)
